# Grasshopper definition Construct_Mesh.ghx (Grasshopper 1.0.7)

# ---- group: Convex
crv = Curve(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)

# ---- group: Concave
crv_2 = Curve(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)

# ----
python = GhPythonScript(CURVE=crv)  # -> POINTS, MESH_STEP, MESH_CENTER
# ---------- python: Python ----------
import rhinoscriptsyntax as rs


def point_polyline(curve):
    
    pts = []
    
    ### Start Point
    start_ = rs.CurveStartPoint(curve)
    pts.append(start_)
    
    ### Mid Points
    mid_points = rs.CurveDiscontinuity(curve, 2)
    for i in xrange(len(mid_points)):
        pts.append(mid_points[i])
    
    ### End Point
    # end_ = rs.CurveEndPoint(curve)
    # pts.append(end_)
    
    return pts



def construct_mesh_step(points):
    
    meshes = []
    
    ### step
    for i in xrange(1, len(points) - 1):
        vertex_ = [(0, int(i), int(i)+1, int(i)+1)]
        m = rs.AddMesh(points, vertex_)
        meshes.append(m)
        
    mesh_joined = rs.JoinMeshes(meshes)
    
    return mesh_joined



def construct_mesh_center(points):
    
    meshes = []
    
    ### calc center point
    bbox = rs.BoundingBox(points)
    line = rs.AddLine(bbox[0], bbox[6])
    c = rs.CurveMidPoint(line)
    
    ### set new point list
    points.append(c)
    
    ###
    c_index = len(points) - 1
    # print(c_index)
    
    for j in xrange(len(points) - 1):
        if j < (len(points) - 2):
            vertex_ = [(c_index, int(j), int(j)+1, int(j)+1)]
            # print(vertex_)
            m = rs.AddMesh(points, vertex_)
            meshes.append(m)
        else:
            vertex_ = [(c_index, int(j), 0, 0)]
            # print(vertex_)
            m = rs.AddMesh(points, vertex_)
            meshes.append(m)
    
    mesh_joined = rs.JoinMeshes(meshes)
    
    return mesh_joined



points = point_polyline(CURVE)
# print(points)


point_cp_0 = rs.coerce3dpointlist(rs.CopyObjects(points))
point_cp_1 = rs.coerce3dpointlist(rs.CopyObjects(points))


step = construct_mesh_step(point_cp_0)
center = construct_mesh_center(point_cp_1)



POINTS_ = points
MESH_STEP_ = step
MESH_CENTER_ = center
# ---------- end python ----------
mesh = Mesh(python.MESH_CENTER)
medges = MeshEdges(Mesh=python.MESH_STEP)  # -> NakedEdges, InteriorEdges, NonManifoldEdges
medges_2 = MeshEdges(Mesh=python.MESH_CENTER)  # -> NakedEdges, InteriorEdges, NonManifoldEdges
serialnumber = SerialNumber(ITEM=python.POINTS)  # -> L, T; inputs ITEM: list
# ---------- serialnumber: Python ----------
import rhinoscriptsyntax as rs
import ghpythonlib.components as ghpc



def convert_data(point_list, offset):
    
    loc = []
    tex = []
    
    print(offset)
    
    
    if offset:
        ofs = offset
    else:
        ofs = 20
        # print(None)
    
    
    for i in xrange(len(point_list)):
        #ghpc.TextTag(rs.coerce3dpoint(ITEM[i]), str(i))
        #ghpc.TextTag(rs.coerce3dpoint(ITEM[i]), "hello")
        
        loc.append(rs.PointAdd(point_list[i], (0, ofs, 0)))
        tex.append(str(i))
        
    return loc,tex


### POINT
pt_list = ITEM

L_, T_ = convert_data(pt_list, OFFSET)
# ---------- end serialnumber ----------
tag = TextTag(Location=serialnumber.L, Text=serialnumber.T)
